# Grasshopper definition lunchbox3_structure2.gh (Grasshopper 0.9.61)
# plug-ins: LunchBox

srf = Surface(<surface referenced from the Rhino model>)
hex = HexagonalStructure(
    Surface=srf,
    UDivisions=Slider(10, range=0..50),
    VDivisions=Slider(16, range=0..50),
    AdjustShape=Slider(0.33, range=0..1),
    Type=Toggle(False))  # -> StructureLines, StructureNodes
pipe = Pipe(Curve=hex.StructureLines, Radius=Slider(0.2, range=0..1), Caps=1)
srf_2 = Surface(<surface referenced from the Rhino model>)
number_slider = Slider(0.2, range=0..1)
spacetruss_1 = SpaceTrussStructure1(Surface=srf_2, UDivisions=Slider(6, range=0..50), VDivisions=Slider(10, range=0..50), TrussDepth=Slider(2, range=-5..5))  # -> LinesA, LinesB, Web, Nodes
pipe_2 = Pipe(Curve=spacetruss_1.LinesA, Radius=number_slider, Caps=1)
pipe_3 = Pipe(Curve=spacetruss_1.LinesB, Radius=number_slider, Caps=1)
pipe_4 = Pipe(Curve=spacetruss_1.Web, Radius=Slider(0.1, range=0..1), Caps=1)
