# Grasshopper definition lunchbox6_panelize3.gh (Grasshopper 0.9.61)
# plug-ins: LunchBox

srf = Surface(<surface referenced from the Rhino model>)
qgrid = QuadGrid(Surface=srf, UDivisions=Slider(8, range=0..50), VDivisions=Slider(14, range=0..50))  # -> CornerPoint1, CornerPoint2, CornerPoint3, CornerPoint4, MidPoint, Normals
amp = Amplitude(Vector=qgrid.Normals, Amplitude=Slider(2, range=0..10))
move = Move(Geometry=qgrid.CornerPoint4, Motion=amp)  # -> Geometry, Transform
srf4pt = _4PointSurface(CornerA=qgrid.CornerPoint1, CornerB=qgrid.CornerPoint2, CornerC=move.Geometry)
srf4pt_2 = _4PointSurface(CornerA=qgrid.CornerPoint2, CornerB=move.Geometry, CornerC=qgrid.CornerPoint3)
srf4pt_3 = _4PointSurface(CornerA=qgrid.CornerPoint3, CornerB=qgrid.CornerPoint4, CornerC=move.Geometry)
