# Grasshopper definition lunchbox7_panelize4.gh (Grasshopper 0.9.61)
# plug-ins: LunchBox

srf = Surface(<surface referenced from the Rhino model>)
qgrid = QuadGrid(Surface=srf, UDivisions=Slider(6, range=0..50), VDivisions=Slider(40, range=0..50))  # -> CornerPoint1, CornerPoint2, CornerPoint3, CornerPoint4, MidPoint, Normals
lng = ListLength(List=qgrid.CornerPoint4)
random = Random(Range=Domain(0, 1), Number=lng, Seed=2)
multiplication = Multiplication(A=random, B=Slider(0.8, range=0..1))
vec2pt = Vector2Pt(PointA=qgrid.CornerPoint1, PointB=qgrid.CornerPoint4, Unitize=False)  # -> Vector, Length
vec2pt_2 = Vector2Pt(PointA=qgrid.CornerPoint2, PointB=qgrid.CornerPoint3, Unitize=False)  # -> Vector, Length
multiplication_2 = Multiplication(A=vec2pt.Vector, B=multiplication)
multiplication_3 = Multiplication(A=vec2pt_2.Vector, B=multiplication)
addition = Addition(A=multiplication_2, B=qgrid.CornerPoint1)
addition_2 = Addition(A=multiplication_3, B=qgrid.CornerPoint2)
srf4pt = _4PointSurface(CornerA=qgrid.CornerPoint1, CornerB=qgrid.CornerPoint2, CornerC=addition_2, CornerD=addition)
