# Grasshopper definition lunchbox8_panelize5.gh (Grasshopper 0.9.61)
# plug-ins: LunchBox

srf = Surface(<surface referenced from the Rhino model>)
pt = Point([<point referenced from the Rhino model> x2])
dgrid = DiamondGrid(Surface=srf, UDivisions=Slider(12, range=0..50), VDivisions=Slider(22, range=0..50))  # -> CornerPoint1, CornerPoint2, CornerPoint3, CornerPoint4, MidPoint, Normals
attract = Attractor(AttractorPoints=pt, TargetPoints=dgrid.MidPoint, AttractorDomain=Domain(0, 1))  # -> Values, Vectors, Distances
subtraction = Subtraction(A="1", B=attract.Values)
multiplication = Multiplication(A=Slider(3, range=0..5), B=subtraction)
amp = Amplitude(Vector=dgrid.Normals, Amplitude=multiplication)
move = Move(Geometry=dgrid.MidPoint, Motion=amp)  # -> Geometry, Transform
srf4pt = _4PointSurface(CornerA=dgrid.CornerPoint1, CornerB=dgrid.CornerPoint2, CornerC=move.Geometry)
srf4pt_2 = _4PointSurface(CornerA=dgrid.CornerPoint2, CornerB=dgrid.CornerPoint3, CornerC=move.Geometry)
srf4pt_3 = _4PointSurface(CornerA=dgrid.CornerPoint3, CornerB=dgrid.CornerPoint4, CornerC=move.Geometry)
srf4pt_4 = _4PointSurface(CornerA=dgrid.CornerPoint4, CornerB=dgrid.CornerPoint1, CornerC=move.Geometry)
